# Grasshopper definition interactivegh5.gh (Grasshopper 1.0.8)
# plug-ins: RhinoCodePluginGH, Speckle 2, Pufferfish, BitmapPlus, Javid

camera_stream = CameraStream()

# ----
# Color Blue
replace_channels = ReplaceChannels(Image=camera_stream, Alpha=0, Red=1, Green=0, Blue=0)
image_to_bitmap = ImageToBitmap(Image=replace_channels)
bitmap_to_mat = BitmapToMat(Bmp=image_to_bitmap)  # -> Mat
#   port Mat: OpenCV Mat image
# ---------- bitmap_to_mat: Python ----------
from Grasshopper.Kernel import GH_RuntimeMessageLevel as level
from System.Drawing import Bitmap
from euglena import utilities

if Bmp is None:
    ghenv.Component.AddRuntimeMessage(
        level.Warning, "Input parameter Bmp failed to collect data"
    )
elif isinstance(Bmp, Bitmap):
    Mat = utilities.bmp_to_mat(Bmp)
else:
    ghenv.Component.AddRuntimeMessage(
        level.Error,
        f"Data conversion failed from {type(Bmp).__name__} to Bitmap",
    )
# ---------- end bitmap_to_mat ----------
image_contour = ImageContour(Mat=bitmap_to_mat, Thresh=Slider(201.1, range=0..255))  # -> Image, Contours; inputs Thresh: Int32
#   port Mat: OpenCV Mat image
#   port Thresh: Pixels with values below the threshold are set to black, while those above or equal to the threshold are set to white
#   port Image: A list of segmented masks. Each mask contains pixel values that indicate the confidence level of being part of a specific category supported by the model. [0-255]
#   port Contours: A list of polylline.
# ---------- image_contour: Python ----------
import numpy as np
from Grasshopper.Kernel import GH_RuntimeMessageLevel as level
from euglena import utilities

if Mat is None:
    ghenv.Component.AddRuntimeMessage(
        level.Warning, "Input parameter Mat failed to collect data"
    )
elif isinstance(Mat, np.ndarray):
    Image, Contours = utilities.contour(Mat, Thresh)
else:
    ghenv.Component.AddRuntimeMessage(
        level.Warning, f"Data conversion failed from {type(Mat).__name__} to Mat"
    )
# ---------- end image_contour ----------
mat_to_bitmap = MatToBitmap(Mat=image_contour.Image)  # -> Bmp; disabled
#   port Mat: OpenCV Mat image
# ---------- mat_to_bitmap: Python ----------
import numpy as np
from Grasshopper.Kernel import GH_RuntimeMessageLevel as level
from euglena import utilities

if Mat is None:
    ghenv.Component.AddRuntimeMessage(
        level.Warning, "Input parameter Mat failed to collect data"
    )
elif isinstance(Mat, np.ndarray):
    Bmp = utilities.mat_to_bmp(Mat)
else:
    ghenv.Component.AddRuntimeMessage(
        level.Error,
        f"Data conversion failed from {type(Mat).__name__} to Mat",
    )
# ---------- end mat_to_bitmap ----------
curve = Curve(image_contour.Contours)
clean_tree = CleanTree(RemoveNulls=invert(True), RemoveInvalid=True, RemoveEmpty=False, Tree=curve)
area = Area(Geometry=clean_tree)  # -> Area, Centroid
smaller_than = SmallerThan(FirstNumber="1000", SecondNumber=area.Area)  # -> SmallerThan, OrEqualTo
sort_list = SortList(Keys=area.Area)  # -> Keys, ValuesValuesA; disabled
cull_pattern = CullPattern(List=clean_tree, CullPattern=smaller_than.SmallerThan)
last_index = LastIndex(List=sort_list.Keys)  # disabled
cull_index = CullIndex(List=cull_pattern, Indices=0, Wrap=True)
reduce = Reduce(Polyline=cull_index, Tolerance=5)  # -> Polyline, Reduction
brep = Brep(reduce.Polyline)
unit_z = UnitZ(Factor=Slider(79, range=0..110))
extrude = Extrude(Base=brep, Direction=unit_z)

# ----
# Color Green
extract_filter = ExtractFilter(Image=camera_stream, Mode=5)
replace_channels_2 = ReplaceChannels(Image=camera_stream, Alpha=0, Red=0, Green=3, Blue=0)  # disabled
image_to_bitmap_2 = ImageToBitmap(Image=extract_filter)
bitmap_to_mat_2 = BitmapToMat(Bmp=image_to_bitmap_2)  # -> Mat; same code as bitmap_to_mat
image_contour_2 = ImageContour(Mat=bitmap_to_mat_2, Thresh=Slider(83.7, range=0..255))  # -> Image, Contours; inputs Thresh: Int32; same code as image_contour
curve_2 = Curve(image_contour_2.Contours)
mat_to_bitmap_2 = MatToBitmap(Mat=image_contour_2.Image)  # -> Bmp; disabled; same code as mat_to_bitmap
clean_tree_2 = CleanTree(RemoveNulls=invert(True), RemoveInvalid=True, RemoveEmpty=False, Tree=curve_2)
panel = Panel("1000")
area_2 = Area(Geometry=clean_tree_2)  # -> Area, Centroid
smaller_than_2 = SmallerThan(FirstNumber="100", SecondNumber=area_2.Area)  # -> SmallerThan, OrEqualTo
sort_list_2 = SortList(Keys=area_2.Area)  # -> Keys, ValuesValuesA; disabled
cull_pattern_2 = CullPattern(List=clean_tree_2, CullPattern=smaller_than_2.SmallerThan)
last_index_2 = LastIndex(List=sort_list_2.Keys)  # disabled
cull_index_2 = CullIndex(List=cull_pattern_2, Indices=0, Wrap=True)
reduce_2 = Reduce(Polyline=cull_index_2, Tolerance=5)  # -> Polyline, Reduction
brep_2 = Brep(reduce_2.Polyline)
unit_z_2 = UnitZ(Factor=Slider(59, range=0..110))
extrude_2 = Extrude(Base=brep_2, Direction=unit_z_2)

# ----
# Color Red
bitmap_to_mat_3 = BitmapToMat(Bmp=camera_stream)  # -> Mat; same code as bitmap_to_mat
image_contour_3 = ImageContour(Mat=bitmap_to_mat_3, Thresh=Slider(109.6, range=0..255))  # -> Image, Contours; inputs Thresh: Int32; same code as image_contour
curve_3 = Curve(image_contour_3.Contours)
clean_tree_3 = CleanTree(RemoveNulls=invert(True), RemoveInvalid=True, RemoveEmpty=False, Tree=curve_3)
area_3 = Area(Geometry=clean_tree_3)  # -> Area, Centroid
smaller_than_3 = SmallerThan(FirstNumber="1000", SecondNumber=area_3.Area)  # -> SmallerThan, OrEqualTo
sort_list_3 = SortList(Keys=area_3.Area)  # -> Keys, ValuesValuesA; disabled
cull_pattern_3 = CullPattern(List=clean_tree_3, CullPattern=smaller_than_3.SmallerThan)
last_index_3 = LastIndex(List=sort_list_3.Keys)  # disabled
cull_index_3 = CullIndex(List=cull_pattern_3, Indices=0, Wrap=True)
reduce_3 = Reduce(Polyline=cull_index_3, Tolerance=5)  # -> Polyline, Reduction
brep_3 = Brep(reduce_3.Polyline)
unit_z_3 = UnitZ(Factor=Slider(52, range=0..110))
extrude_3 = Extrude(Base=brep_3, Direction=unit_z_3)

preview_bitmap = PreviewBitmap(Bitmap=image_to_bitmap_2, LockAspect=False)  # disabled
preview_bitmap_2 = PreviewBitmap(Bitmap=image_to_bitmap, LockAspect=False)  # disabled
preview_bitmap_3 = PreviewBitmap(Bitmap=camera_stream, LockAspect=False)

# ---- group: border
border = ListItem(List=curve_2, Index=0, Wrap=True)

# ----
mesh = Mesh(<mesh referenced from the Rhino model>)
custom_preview = CustomPreview(Geometry=extrude_3, Material=ColourSwatch(SwatchColor=RGB(223, 20, 0)))

# ---- group: Single Tree / single tree
area_4 = Area(Geometry=mesh)  # -> Area, Centroid
unit_z_4 = UnitZ(Factor=Slider(-30, range=-100..0))
move = Move(Geometry=area_4.Centroid, Motion=unit_z_4)  # -> Geometry, Transform

# ---- group: Single Tree
area_5 = Area(Geometry=cull_index_2)  # -> Area, Centroid
smaller_than_4 = SmallerThan(FirstNumber="2500", SecondNumber=area_5.Area)  # -> SmallerThan, OrEqualTo
cull_pattern_4 = CullPattern(List=area_5.Centroid, CullPattern=invert(smaller_than_4.SmallerThan))
list_length = ListLength(List=cull_pattern_4)
xy_plane = XYPlane(Origin=cull_pattern_4)
move_to_point = MoveToPoint(Geometry=mesh, PointA=move.Geometry, PointB=cull_pattern_4)  # -> Moved, Vector, Transform
random = Random(Range=Domain(0, 180), Number=list_length, Seed=2)
rotate = Rotate(Geometry=move_to_point.Moved, Angle=degrees(random), Plane=xy_plane)  # -> Geometry, Transform

# ---- group: Multiple Trees
cull_pattern_5 = CullPattern(List=cull_index_2, CullPattern=smaller_than_4.SmallerThan)
area_6 = Area(Geometry=cull_pattern_5)  # -> Area, Centroid
division = Division(A=area_6.Area, B=Slider(1321, range=0..6100))
integer = Integer(division)
populate_2d = Populate2D(Region=cull_pattern_5, Count=integer, Seed=1)
list_length_2 = ListLength(List=populate_2d)
move_to_point_2 = MoveToPoint(Geometry=mesh, PointA=move.Geometry, PointB=populate_2d)  # -> Moved, Vector, Transform
random_2 = Random(Range=Domain(1, 1.2), Number=list_length_2, Seed=2)
xy_plane_2 = XYPlane(Origin=populate_2d)
scale_nu = ScaleNU(Geometry=move_to_point_2.Moved, Plane=PlaneXY(0, 0, 0), ScaleX=1, ScaleY=1, ScaleZ=random_2)  # -> Geometry, Transform
random_3 = Random(Range=Domain(0, 180), Number=list_length_2, Seed=2)
rotate_2 = Rotate(Geometry=scale_nu.Geometry, Angle=degrees(random_3), Plane=xy_plane_2)  # -> Geometry, Transform
merge = Merge(Data1=rotate_2.Geometry, Data2=rotate.Geometry)

# ----
custom_preview_2 = CustomPreview(Geometry=extrude, Material=ColourSwatch(SwatchColor=RGB(47, 220, 255)))
custom_preview_3 = CustomPreview(Geometry=extrude_2, Material=ColourSwatch(SwatchColor=RGB(47, 220, 48)))
mesh_2 = Mesh(merge)

# ---- group: Speckle
merge_2 = Merge(Data1=extrude_3, Data2=extrude, Data3=mesh_2)
clean_tree_4 = CleanTree(RemoveNulls=True, RemoveInvalid=True, RemoveEmpty=False, Tree=merge_2)
accounts = Accounts(
    {"No account selected": , "Account (atakanalpokan@gmail.com | https://app.speckle.systems)": "https://app.speckle.systems/?id=60806e7388"}, selected="Account (atakanalpokan@gmail.com | https://app.speckle.systems)",
    FirstSelectedItem="https://app.speckle.systems/?id=60806e7388")
data = Data(clean_tree_4)
create_speckle_object = CreateSpeckleObject(A=data, selectedKitName="Objects")
speckle_schema_object = RenderMaterial(
    Opacity=1,
    Metalness=0,
    Roughness=1,
    Diffuse=ColourSwatch(SwatchColor=RGB(199, 56, 0)),
    SelectedConstructorName="Objects.Other.RenderMaterial.ctor(System.Double,System.Double,System.Double,System.Nullable`1[System.Drawing.Color],System.Nullable`1[System.Drawing.Color])",
    SelectedTypeName="Objects.Other.RenderMaterial",
    UseSchemaTag=False,
    UserSetSchemaTag=False,
    seed="497763826a8ed24e336d")
extend_speckle_object = ExtendSpeckleObject(SpeckleObject=create_speckle_object, RenderMaterial=speckle_schema_object, selectedKitName="Objects")
stream_list = StreamList(SpeckleAccount=accounts, Limit=10)
list_item = ListItem(List=stream_list, Index=0, Wrap=True)
send = Send(
    Stream=list_item,
    Message="final batch",
    Data=extend_speckle_object,
    AutoSend=True,
    BaseId="1836b901343a805a4ac5be1ca8ef4f0f",
    CurrentComponentState="up_to_date",
    KitName="Objects",
    OutputWrappers="https://app.speckle.systems\ta4112fccde\t0e8d049fe8",
    UseDefaultCache=True,
    selectedKitName="Objects")

# ----
custom_preview_4 = CustomPreview(Geometry=merge, Material=ColourSwatch(SwatchColor=RGB(231, 226, 255)))
